# Grasshopper definition sprucebeetle_examples.gh (Grasshopper 1.0.8)
# plug-ins: Spruce Beetle

csv_2_oc = CSVToOffcut(FilePath="Insert file path to offcuts.csv here", Delimiter=";")

# ----
# Offcuts from GH Data
panel = Panel("""0.1
0.2
0.3""")
conoffcut = ConstructOffcut(XDimension=panel, YDimension=panel, ZDimension=panel)
panel_2 = Panel(conoffcut)

# ----
# 3D Bin-Packing
panel_3 = Panel("1")
pt = ConstructPoint(XCoordinate=panel_3, YCoordinate=panel_3, ZCoordinate=panel_3)
xy = XYPlane(Origin=pt)
box = CenterBox(Base=xy, X=1, Y=1, Z=1)
packbinc = BinPackingEBAFIT(OffcutData=csv_2_oc, Box=box)  # -> PackedOffcuts, Container
wires = BrepWireframe(Brep=packbinc.Container, Density=-1)
geo = Geometry(packbinc.PackedOffcuts)

# ---- group: provide a curve
crv = Curve()

# Alignment w/ strong Curvature
crv_2 = Curve(<curve referenced from the Rhino model>)

# ----
list = ValueList({"mid-mid", "mid-top", "mid-bottom", "right-mid", "left-mid", "right-top", "right-bottom", "left-bottom", "left-top"}, selected="left-mid")
optialign = OptimizedAlignment(
    Curve=crv_2,
    OffcutData=csv_2_oc,
    OffcutPosition=list,
    StartAngle=Slider(0, range=-180..180),
    EndAngle=Slider(0, range=-180..180))  # -> AlignedOffcuts, UnusedOffcuts, CentroidCurve

# ----
# Alignment with Spline Joints
list_2 = ValueList({"mid-mid", "mid-top", "mid-bottom", "right-mid", "left-mid", "right-top", "right-bottom", "left-bottom", "left-top"}, selected="right-top")
align = CurveAlignment(Curve=crv, OffcutData=csv_2_oc, OffcutPosition=list_2, StartAngle=0, EndAngle=0)  # -> AlignedOffcuts, UnusedOffcuts, CentroidCurve
spline = SplineJoints(AlignedOffcuts=align.AlignedOffcuts, ToolRadius=0.005, JointX=0.02, JointY=0.05, SplineCount="5")  # -> Offcuts, Joints, JointVolume
getb = GetBrep(Offcuts=spline.Offcuts)
geo_2 = Geometry(spline.Joints)

# ----
# Optimized Alignment with Tenon Joints
list_3 = ValueList({"mid-mid", "mid-top", "mid-bottom", "right-mid", "left-mid", "right-top", "right-bottom", "left-bottom", "left-top"}, selected="mid-mid")
optialign_2 = OptimizedAlignment(Curve=crv, OffcutData=csv_2_oc, OffcutPosition=list_3, StartAngle=0, EndAngle=0)  # -> AlignedOffcuts, UnusedOffcuts, CentroidCurve
list_4 = ValueList({"tenon", "cross tenon", "custom tenon"}, selected="tenon")
tenon = TenonJoints(
    AlignedOffcuts=optialign_2.AlignedOffcuts,
    ToolRadius=0.005,
    JointX="0.01",
    JointY="0.01",
    JointZ="0.08",
    JointType=list_4,
    TenonCount="5")  # -> Offcuts, Joints, JointVolume
getb_2 = GetBrep(Offcuts=tenon.Offcuts)
geo_3 = Geometry(tenon.Joints)

# ----
# Offcuts from CSV
panel_4 = Panel("Insert file path to offcuts.csv here")
csv_2_oc_2 = CSVToOffcut(FilePath=panel_4, Delimiter=";")
panel_5 = Panel(csv_2_oc_2)

# ----
# Unification w/ Joints
panel_6 = Panel("0.9")
unify = Unification(Curve=crv_2, AlignedOffcuts=optialign.AlignedOffcuts, Scale=panel_6)  # disabled
# Joints
panel_7 = Panel("1")
spline_2 = SplineJoints(AlignedOffcuts=unify, ToolRadius=0.005, JointX=0.02, JointY=0.05, SplineCount=panel_7)  # -> Offcuts, Joints, JointVolume
getb_3 = GetBrep(Offcuts=spline_2.Offcuts)
geo_4 = Geometry(spline_2.Joints)

spline_3 = SplineJoints(AlignedOffcuts=optialign.AlignedOffcuts, ToolRadius=0.005, JointX=0.02, JointY=0.05, SplineCount="4")  # -> Offcuts, Joints, JointVolume
getb_4 = GetBrep(Offcuts=spline_3.Offcuts)
geo_5 = Geometry(spline_3.Joints)

# ----
# Offcuts from JSON
panel_8 = Panel("Insert file path to offcuts.json here")
to_offcut = JSONToOffcut(FilePath=panel_8)
panel_9 = Panel(to_offcut)

# ----
# Offcuts to JSON
panel_10 = Panel("Insert file path here")
to_json = OffcutToJSON(OffcutData=spline.Offcuts, FilePath=panel_10)
