# Grasshopper definition offcut_tales.gh (Grasshopper 1.0.7)
# plug-ins: Spruce Beetle

# ---- group: offcut data
csv_to_offcut = CSVToOffcut(FilePath="Insert path to: \offcuts.csv", Delimiter=";")

# ---- group: arc 1
list = ValueList({"mid-mid", "mid-top", "mid-bottom", "right-mid", "left-mid", "right-top", "right-bottom", "left-bottom", "left-top"}, selected="left-bottom")
crv = Curve(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)
optialign = OptimizedAlignment(
    Curve=crv,
    OffcutData=csv_to_offcut,
    OffcutPosition=list,
    StartAngle=Slider(-30, range=-180..180),
    EndAngle=Slider(-30, range=-180..180))  # -> AlignedOffcuts, UnusedOffcuts, CentroidCurve

# ---- group: arc 2
list_2 = ValueList({"mid-mid", "mid-top", "mid-bottom", "right-mid", "left-mid", "right-top", "right-bottom", "left-bottom", "left-top"}, selected="right-top")
crv_2 = Curve(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)
optialign_2 = OptimizedAlignment(
    Curve=crv_2,
    OffcutData=optialign.UnusedOffcuts,
    OffcutPosition=list_2,
    StartAngle=Slider(30, range=-180..180),
    EndAngle=Slider(30, range=-180..180))  # -> AlignedOffcuts, UnusedOffcuts, CentroidCurve

# ---- group: arc 3
list_3 = ValueList({"mid-mid", "mid-top", "mid-bottom", "right-mid", "left-mid", "right-top", "right-bottom", "left-bottom", "left-top"}, selected="left-bottom")
crv_3 = Curve(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)
optialign_3 = OptimizedAlignment(
    Curve=crv_3,
    OffcutData=optialign_2.UnusedOffcuts,
    OffcutPosition=list_3,
    StartAngle=Slider(90, range=0..180),
    EndAngle=Slider(90, range=0..180))  # -> AlignedOffcuts, UnusedOffcuts, CentroidCurve

# ---- group: display w/o joints
merge = Merge(Data1=optialign.AlignedOffcuts, Data2=optialign_2.AlignedOffcuts, Data3=optialign_3.AlignedOffcuts)  # -> flatten(Result)
getb = GetBrep(Offcuts=merge)

# ---- group: joints
spline = SplineJoints(AlignedOffcuts=optialign.AlignedOffcuts, ToolRadius="0.008", JointX="0.03", JointY="0.055", SplineCount="2")  # -> flatten(Offcuts), Joints, JointVolume
spline_2 = SplineJoints(AlignedOffcuts=optialign_2.AlignedOffcuts, ToolRadius="0.008", JointX="0.03", JointY="0.055", SplineCount="2")  # -> flatten(Offcuts), Joints, JointVolume
spline_3 = SplineJoints(AlignedOffcuts=optialign_3.AlignedOffcuts, ToolRadius="0.008", JointX="0.03", JointY="0.055", SplineCount="2")  # -> flatten(Offcuts), Joints, JointVolume

# ---- group: display w/ joints
merge_2 = Merge(Data1=spline.Offcuts, Data2=spline_2.Offcuts, Data3=spline_3.Offcuts)
getb_2 = GetBrep(Offcuts=flatten(merge_2))
joint_geometry = Brep(flatten([spline.Joints, spline_2.Joints, spline_3.Joints]))
